test file "TestDoorLockCntr"
  coverage: Decision, MCDC, Condition

suite "DoorLockCntr/DoorLockCommand"

  case "DoorLockCommand_harness" [baseline]
    model DoorLockCntr, harness DoorLockCommand_harness (for DoorLockCntr/DoorLockCommand)
    input "testcase" from tc_DoorLockCommand.xlsx, mapped to Speed, EngStart, AirBagOn (active)
    baseline "testcase"
      DLockCmd

suite "DoorLockCntr/DoorLockDiagnostics"

  case "DoorLockDiagnostics_Harness" [baseline]
    model DoorLockCntr, harness DoorLockDiagnostics_Harness (for DoorLockCntr/DoorLockDiagnostics)
    input "testcase_normal" from tc_DoorLockDiagnostics.xlsx, mapped to DLockCmd, LeftDPos, RightDPos (active)
    input "testcase_fail" from tc_DoorLockDiagnostics.xlsx, mapped to DLockCmd, LeftDPos, RightDPos
    baseline "testcase_normal"
      DLockDiag
    baseline "testcase_fail"
      DLockDiag
    iterations:
      Iteration1: ExternalInput "testcase_normal", Baseline "testcase_normal"
      Iteration2: ExternalInput "testcase_fail", Baseline "testcase_fail"

suite "DoorLockCntr"

  case "DoorLockCntr_Harness" [baseline]
    model DoorLockCntr, harness DoorLockCntr_Harness
    input "NORMAL1" from tc_DoorLockCntr.xlsx, mapped to AirBagOn, EngStart, Speed, LeftDPos, RightDPos (active)
    input "FAIL1" from tc_DoorLockCntr.xlsx, mapped to AirBagOn, EngStart, Speed, LeftDPos, RightDPos
    baseline "NORMAL1"
      DLockCmd
      DLockDiag
    baseline "FAIL1"
      DLockCmd
      DLockDiag
    iterations:
      Iteration1: ExternalInput "NORMAL1", Baseline "NORMAL1"
      Iteration2: ExternalInput "FAIL1", Baseline "FAIL1"